# Grasshopper definition portal-example.gh (Grasshopper 1.0.7)
# plug-ins: Portal.Gh

# Memory Mapped File
panel = Panel("TestMemoryBlock")
# WebSocket
number_slider = Slider(6001, range=0..10000)
# UDP
number_slider_2 = Slider(6000, range=0..10000)
# Pipe
panel_2 = Panel("TestPipe")
concat = Concatenate(FragmentA="hey there from meory ", FragmentB=Slider(2380, range=0..10000))
memory = SharedMemoryWriter(MemoryName=panel, Message=concat, Write=Toggle(False))
pipe = NamedPipeSender(ServerName=".", PipeName=panel_2, Message="hey there from pipe", Send=Button())
ws_client = WebSocketClient(HostIP="127.0.0.1", Port=number_slider, Route="/test", Message="hey there from ws client", Send=Button())
udp = UDPSender(ServerIP="127.0.0.1", Port=number_slider_2, Message="hey there from client 4", Send=Button())
udp_2 = UdpReceiver(Port=number_slider_2, Start=Toggle(False))
pipe_2 = NamedPipeReceiver(PipeName=panel_2, BufferSize=4096, Start=Toggle(False))
ws_server = WebSocketServer(Port=number_slider, Route="/test", Start=Toggle(False))
memory_2 = SharedMemoryAutoReader(MemoryName=panel, Interval=Slider(200, range=0..1000), Start=Toggle(False))  # -> Data, DataSize
memory_3 = SharedMemoryReader(MemoryName=panel, Start=Button())  # -> Data, DataSize
panel_3 = Panel(pipe_2)
panel_4 = Panel(udp_2)
panel_5 = Panel(ws_server)
panel_6 = Panel(memory_2.Data)
panel_7 = Panel(memory_2.DataSize)
panel_8 = Panel(memory_3.Data)
panel_9 = Panel(memory_3.DataSize)
info = NetworkInfo()  # -> Properties, LocalIP
panel_10 = Panel(info.Properties)
